# Grasshopper definition S2-intro-to-graphs.gh (Grasshopper 1.0.8)
# plug-ins: RhinoCodePluginGH, ShapeDiverForGrasshopper, Kangaroo2 Components

rectangle = Rectangle(Plane=PlaneXY(0, 0, 0), XSize=Slider(10, range=0..10), YSize=Slider(10, range=0..10), Radius=0)  # -> Rectangle, Length
mesh_plane = MeshPlane(Boundary=rectangle.Rectangle, WidthCount=Slider(15, range=0..100), HeightCount=Slider(15, range=0..100))  # -> Mesh, Area
mesh = Mesh(mesh_plane.Mesh)
deconstruct_mesh = DeconstructMesh(Mesh=mesh)  # -> Vertices, Faces, Colours, Normals
nakedvertices = NakedVertices(Mesh=mesh)  # -> ClothedIndex, NakedIndex, ClothedPts, NakedPts
point = Point(nakedvertices.NakedPts)
point_2 = Point([Point(-0.01444754834, 0.2783907913, 0), Point(2.957804737, 0, 0), Point(7, 0, 0), Point(10, 2.447598033, 0), Point(10, 6.992033036, 0), Point(9, 10, 0), Point(5, 10, 0), Point(2.392723678, 10.00784481, 0), Point(-0.02003746547, 8.992326052, 0), Point(0, 3, 0)])
sphere = Sphere(Base=point_2, Radius=Slider(0.449, range=0..10))
point_in_breps = PointInBreps(Brep=sphere, Point=point, Strict=False)  # -> Inside, Index
dispatch = Dispatch(List=point, DispatchPattern=point_in_breps.Inside)  # -> ListA, ListB
# Sara's Mesh
number_slider = Slider(0.039, range=0..0.1)
unit_z = UnitZ(Factor=1)
point_3 = Point(dispatch.ListA)
edgelengths = EdgeLengths(Mesh=mesh, LengthFactor=number_slider, Strength=1)
load = Load(Point=deconstruct_mesh.Vertices, ForceVector=unit_z, Weighting=Slider(0.107, range=0..1))
show = Show(G=mesh)
anchorxyz = AnchorXYZ(Point=dispatch.ListB, X=Toggle(False), Y=Toggle(False), Z=Toggle(False), Strength=1000)
anchor = Anchor(Point=point_3, Strength=10000)
merge = Merge(Data1=flatten(show), Data2=flatten(edgelengths), Data3=flatten(load), Data4=flatten(anchor), Data5=flatten(anchorxyz))
solver = Solver(GoalObjects=merge, Reset=Button(), Threshold=1e-15, Tolerance=0.0001, On=Toggle(True))  # -> I, V, O
list_item = ListItem(List=solver.O, Index=0, Wrap=True)
deconstruct_mesh_2 = DeconstructMesh(Mesh=list_item)  # -> Vertices, Faces, Colours, Normals
mesh_colours = MeshColours(Mesh=list_item, Colours=deconstruct_mesh_2.Normals)

list = ValueList({"graphs-01-intro": 0, "graphs-02-graph-from-mesh": 1, "graphs-03-with-data": 2, "graphs-04-dual-graph": 3, "graphs-05-shorest-paths": 4}, selected="graphs-05-shorest-paths")
graphs_02_graph_from_mesh = FilePath("C:\Users\Nehad\Desktop\Python\Session 2 Python\session02\graphs\graphs-02-graph-from-mesh.py")
graphs_05_shorest_paths = FilePath("C:\Users\Nehad\Desktop\Python\Session 2 Python\session02\graphs\graphs-05-shorest-paths.py")
graphs_04_dual_graph = FilePath("C:\Users\Nehad\Desktop\Python\Session 2 Python\session02\graphs\graphs-04-dual-graph.py")
graphs_03_with_data = FilePath("C:\Users\Nehad\Desktop\Python\Session 2 Python\session02\graphs\graphs-03-with-data.py")
graphs_01_intro = FilePath("C:\Users\Nehad\Desktop\Python\Session 2 Python\session02\graphs\graphs-01-intro.py")
number_slider_2 = Slider(2, range=0..10)  # disabled
filter = StreamFilter(
    Gate=list,
    Stream0=graphs_01_intro,
    Stream1=graphs_02_graph_from_mesh,
    Stream2=graphs_03_with_data,
    Stream3=graphs_04_dual_graph,
    Stream4=graphs_05_shorest_paths)
mplane = MeshPlane(
    Boundary={Plane=PlaneXY(0, 0, 0), Size=Domain2(u=-10..10, v=-10..10)},
    WidthCount=number_slider_2,
    HeightCount=number_slider_2)  # -> Mesh, Area; disabled
trimesh = Mesh(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)  # disabled
quadmesh = Mesh(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)  # disabled
structured_coarse_mesh = Mesh(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)  # disabled
panel = Panel(filter)
file = ReadFile(File=filter, PerLineParse=False)
number_slider_3 = Slider(5, range=0..10)
preview = CustomPreview(
    Geometry=mesh_colours,
    Material={diffuse=RGB(221, 160, 221), emission=RGB(66, 48, 66), shine=0.5, specular=RGB(255, 255, 255), transparency=0})
demesh = DeconstructMesh(Mesh=mesh_colours)  # -> Vertices, Faces, Colours, Normals
py3 = Python3Script(script=file, m=mesh_colours, s=Slider(31, range=0..100), t=Slider(86, range=0..100))  # -> out, a, b, c; inputs m: Mesh, s: Int32, t: Int32; unedited script template
conmesh = ConstructMesh(Vertices=demesh.Vertices, Faces=graft(demesh.Faces))  # -> flatten(Mesh)
points = PointList(Points=py3.a)
item = ListItem(List=conmesh, Index=py3.c, Wrap=True)

sddp = ShapeDiverDocumentPayload({AbsoluteTolerance=0, AngleTolerance=0, DistanceDisplayPrecision=0, GltfVersion="Gltf2", GrasshopperVersion="1.0.0008", InputGroups="{}", OutputGroups="{}", RelativeTolerance=0, RhinoVersion="8.11.24254.15001", UnitSystem=0, VersionCreated="1.23.0.0", VersionSaved="1.24.1.0"})
